vi "FSKRxProject.gvi"   [LabVIEW Communications System Design Software 2.0.1]
panel controls:
  "IQ rate": f64 = 400000
  "carrier frequency": f64 = 915000000
  "gain (dB)": f64
  "active antenna": string = "RX2"
  "symbol rate (sym/s)": i64 = 10000
  "Device names": string = "NI2900RX"
  "adc.m path": path = path "C:\\Users\\MSI\\Documents\\MATLAB\\5\\EE3001\\MATLAB Exercises\\Project\\newsound"
  "Noise Selection": T1 = "Drill Sound"
panel indicators:
  "actual IQ rate": f64
  "actual carrier frequency": f64
  "actual gain (dB)": f64
  "Baseband Output": cluster{"t0": f64, "dt": f64, "Y": f64[]}
  "Eye Diagram": cluster{"t0": f64, "dt": f64, "Y": f64[]}[]
  "Error Corrected Signal": f64[]
  "BER SOFT": f64
  "BER_HARD": f64
  "Errored Signal": f64[]
  "Number of errors without correction": f64
  "Number of errors with soft decision correction": f64
  "Number of errors with hard decision correction": f64
  "RLS Output": f64[]
types:
  T1 = enum{"Drill Sound", "Fan Noise", "Chainsaw Noise"}
  T2 = cluster{"whole seconds": u64, "fractional seconds": f64}
  "filter structure.gtype" = u32
  "filter.gtype" = cluster{"filter structure": "filter structure.gtype", "forward coefficients": f64[], "reverse coefficients": f64[], "sampling frequency": f64}
  "Sound Data Format.gtype" = cluster{"sample rate (S/s)": f64, "number of channels": i32, "bits per sample": i32}
uses:
  NI::Analysis::Conditioning::Unwrap Phase.gvi
  NI::Analysis::Filtering::Filtering with Initial Conditions (DBL).gvi
  NI::Analysis::Operations::1D Convolution (DBL).gvi
  NI::Analysis::Resampling::Decimate (single shot, DBL).gvi
  NI::Analysis::Conditioning::Shift Array.gvi
diagram:
  call "niUSRP Open Rx Session.gvi"(niUSRP Device=$"Device names", reset=TRUE) -> (error out=w1, session handle out=w2)
  call "niUSRP Configure Signal.gvi"(session handle=w2, IQ rate=$"IQ rate", carrier frequency=$"carrier frequency", gain=$"gain (dB)", error in (no error)=w1, active antenna=$"active antenna") -> (session handle out=w3, coerced IQ rate=w4, coerced carrier frequency=w5, coerced gain=w6, Error Out=w7)
  # samples/symbol = Decimation Factor
  Divide(x=w4, y=$"symbol rate (sym/s)") -> w8
  call "niUSRP Configure Time Start Trigger.gvi"(session handle=w3, start trigger time=T2 {"whole seconds"=20, "fractional seconds"=0}, error in (no error)=w7) -> (session handle out=w9, Error Out=w10)
  call "niUSRP Initiate.gvi"(session handle=w9, error in (no error)=w10) -> (session handle out=w11, Error Out=w12)
  Multiply(224000, w8) -> w13
  call "niUSRP Fetch Rx Data (CDB Cluster).gvi"(session handle=w11, number of samples=w13, timeout=50, error in (no error)=w12) -> (session handle out=w14, data=w15, Error Out=w16)
  Property Node(instance in=w15) -> ("dt"=w17, "Y"=w18)
  call "MT Generate Filter Coefficients.gvi"(pulse shaping filter="none", matched samples per symbol=w8, modulation type="FSK") -> (matched filter coefficients=w19)
  Property Node(instance in="filter.gtype" {all zero or empty}, "filter structure"=3, "forward coefficients"=[1, -1], "reverse coefficients"=[1, -1]) -> (instance out=w20)
  # no. samples
  Complex To Polar(r * e^(i*theta)=w18) -> (theta=w21)
  call "Unwrap Phase.gvi"(input phase=w21, phase unit="degree in, radian out"(3)) -> (unwrapped phase=w22)
  call "Filtering with Initial Conditions (DBL).gvi"(signal=w22, filter=w20) -> (filtered signal=w23)
  call "Median Filter2.gvi"(X=w23, left rank=5) -> (Filtered X=w24)
  call "1D Convolution (DBL).gvi"(x=w24, y=w19) -> (x * y=w25)
  w26 = cluster{"t0": f64, "dt": f64, "Y": f64[]} {all zero or empty}
  Property Node(instance in=w26, "dt"=w17, "Y"=w25) -> (instance out=w27)
  call "PulseAlign(real).gvi"(Input Signal=w27, Receiver Sampling Factor=w8) -> (Aligned Signal=w28)
  Property Node(instance in=w28) -> ("Y"=w29)
  call "Decimate (single shot, DBL).gvi"(input array=w29, decimating factor=w8) -> (decimated array=w30)
  Is Greater(x=w30, y=0) -> w31
  Boolean To Integer(Boolean=w31) -> (0, 1=w32)
  Array Subset(array=w32, index0=0, length0=224000) -> w33
  call "Shift Array.gvi"(input array=w33, number of shifts=-1) -> (shifted array=w34)
  Path To String(path=$"adc.m path") -> (string=w35)
  Concatenate Strings(w35, "\\adc.txt") -> w36
  String To Path(string=w36) -> (path=w37)
  # Reading the original bitstream without error
  while {
    Wait(time to wait=500)
    Open Or Create Or Replace File(file path (use dialog)=w37) -> (error out=w38)
    call "Is Error.gvi"(error in=w38) -> (is error?=w39)
    Not(x=w39) -> w40
    stop if w40
  }
  call "Read from Spreadsheet File (DBL).gvi"(file path=w37) -> (all rows=w41)
  Array Index(array=w41) -> (out0[_, 0]=w42)
  # Hamming code implementation
  Math Node("decimalToBinary"=w42, "cwordArray"=w34) -> ("output"=w43, "BERsoft"=w44, "BERhard"=w45, "errored"=w46, "Nerrs"=w47, "Nsoftbiterrs"=w48, "Nhardbiterrs"=w49)
  ~~~
  cwords = [
      0     0     0     0     0     0     0;
      0     0     0     1     0     1     1;
      0     0     1     0     1     1     0;
      0     0     1     1     1     0     1;
      0     1     0     0     1     1     1;
      0     1     0     1     1     0     0;
      0     1     1     0     0     0     1;
      0     1     1     1     0     1     0;
      1     0     0     0     1     0     1;
      1     0     0     1     1     1     0;
      1     0     1     0     0     1     1;
      1     0     1     1     0     0     0;
      1     1     0     0     0     1     0;
      1     1     0     1     0     0     1;
      1     1     1     0     1     0     0;
      1     1     1     1     1     1     1];

  Nerrs = 0; Nsoftbiterrs = 0; Nhardbiterrs = 0; Nblocks = 32000; k = 4; n = 7;

  EbNodB = 6;
  R = 4/7;

  EbNo = 10 ^ (EbNodB / 10);
  sigma = sqrt(1 / (2 * R * EbNo));
  %sigma = 0;

  cwordArray = reshape(cwordArray, 7, 32000)';
  decimalToBinary = reshape(decimalToBinary, 4, 32000)';

  output = zeros(128000,1);
  errored = zeros(128000,1);
  for i = 1 : Nblocks
      msg = decimalToBinary(i, :);
      cword = cwordArray(i, :);
      s = 1 - 2 * cword;
      r = s + sigma * randn(1, n);

      b = (r < 0);
      errored((4*i-3):(4*i)) = b(1:4);
      %%% Hard decision
      dist = mod(repmat(b, 16, 1) + cwords,2) * ones(7, 1);
      [mind1, pos] = min(dist);
      msg_cap1 = cwords(pos, 1:4);

      %%% Soft decision
      corr = (1 - 2 * cwords) * r';
      [mind2, pos] = max(corr);
      msg_cap2 = cwords(pos, 1:4);

      Nbiterrs = sum(msg ~= b(1:4));
      Nharderrs = sum(msg ~= msg_cap1);
      Nsofterrs = sum(msg ~= msg_cap2);

      if Nbiterrs > 0
          Nerrs = Nerrs + Nbiterrs;
      end
      if Nsofterrs > 0
          Nsoftbiterrs = Nsoftbiterrs + Nsofterrs;
      end
      if Nharderrs > 0
          Nhardbiterrs = Nhardbiterrs + Nharderrs;
      end

      output((4*i-3):(4*i)) = msg_cap2;
  end
  Nsoftbiterrs = Nsoftbiterrs(1);

  BERsoft = Nsoftbiterrs/k/Nblocks;
  BERhard = Nhardbiterrs/k/Nblocks;
  ~~~
  $"BER SOFT" <- w44
  call "niUSRP Abort.gvi"(Handle in=w14, error in (no error)=w16) -> (Handle out=w50, Error Out=w51)
  call "niUSRP Close Session.gvi"(handle in=w50, error in=w51) -> (error out=w52)
  call "Simple Error Handler.gvi"(error in=w52)
  $BER_HARD <- w45
  $"Number of errors without correction" <- w47
  $"Number of errors with soft decision correction" <- w48
  $"Baseband Output" <- w27
  $"Number of errors with hard decision correction" <- w49
  $"actual IQ rate" <- w4
  $"actual carrier frequency" <- w5
  $"actual gain (dB)" <- w6
  Array Index(array=w43) -> (out0[_, 0]=w53)
  Reshape Array(inArray=w53, size=8000, size=16) -> w54
  Array Index(array=w46) -> (out0[_, 0]=w55)
  Reshape Array(inArray=w55, size=8000, size=16) -> w56
  # Binary to decimal conversion
  Math Node("decimalToBinary"=w54, "errored"=w56) -> ("errorCorrected"=w57, "erroredSignal"=w58)
  ~~~
      partition = linspace(-1, 1, pow2(16));

      b2d = zeros(8000, 1);
      erroredb2d = zeros(8000, 1);
      for i = 1 : length(decimalToBinary)
          b2d(i, :) = sum(decimalToBinary(i, :) .* pow2(15:-1:0));
          erroredb2d(i, :) = sum(errored(i, :) .* pow2(15:-1:0));
      end

      b2d(b2d == 0) = 1;
      erroredb2d(erroredb2d == 0) = 1;

      errorCorrected = zeros(8000, 1);
      erroredSignal = zeros(8000, 1);
      for i = 1 : length(b2d)
          errorCorrected(i) = partition(b2d(i));
          erroredSignal(i) = partition(erroredb2d(i));
      end
  ~~~
  Array Index(array=w58) -> (out0[_, 0]=w59)
  Array Index(array=w57) -> (out0[_, 0]=w60)
  w61 = $"adc.m path"
  Path To String(path=w61) -> (string=w62)
  Concatenate Strings(w62, "\\noisySpeech.txt") -> w63
  # Writing the noisy speech to a text file
  String To Path(string=w63) -> (path=w64)
  call "Write to Spreadsheet File (DBL).gvi"(file path=w64, 1D data=w60) -> (new file path=w65)
  while {
    Wait(time to wait=500)
    Open Or Create Or Replace File(file path (use dialog)=w65) -> (error out=w66)
    call "Is Error.gvi"(error in=w66) -> (is error?=w67)
    Not(x=w67) -> w68
    stop if w68
  }
  Path To String(path=w61) -> (string=w69)
  Concatenate Strings(w69, "\\rlsOutput.txt") -> w70
  String To Path(string=w70) -> (path=w71)
  while {
    Wait(time to wait=500)
    Open Or Create Or Replace File(file path (use dialog)=w71) -> (error out=w72)
    call "Is Error.gvi"(error in=w72) -> (is error?=w73)
    Not(x=w73) -> w74
    stop if w74
  }
  call "Read from Spreadsheet File (DBL).gvi"(file path=w71) -> (all rows=w75)
  # Reading the RLS output text file created by MATLAB
  Array Index(array=w75) -> (out0[_, 0]=w76)
  Build Array(w59, w60, w76) -> w77
  # Playing the sounds
  for {
    w78 = each element of w77
    Build Waveform Node(Y=w78) -> (output waveform=w79)
    Build Array(w79) -> w80
    w81 = "Sound Data Format.gtype" {"sample rate (S/s)"=8000, "number of channels"=1, "bits per sample"=16}
    call "Sound Output Configure.gvi"(device ID=0, sound format=w81) -> (task ID=w82, error out=w83)
    call "Sound Output Start.gvi"(task ID in=w82, error in=w83) -> (task ID out=w84, error out=w85)
    call "Sound Output Write.gvi"(task ID in=w84, data=w80, error in=w85) -> (task ID out=w86, error out=w87)
    call "Sound Output Start.gvi"(task ID in=w86, error in=w87) -> (task ID out=w88, error out=w89)
    call "Sound Output Wait.gvi"(task ID in=w88, error in=w89) -> (task ID out=w90, error out=w91)
    call "Sound Output Stop.gvi"(task ID in=w90, error in=w91) -> (task ID out=w92, error out=w93)
    call "Sound Output Clear.gvi"(task ID=w92, error in=w93)
  }
  $"Errored Signal" <- w59
  $"RLS Output" <- w76
  Array Subset(array=w25, index0=0, length0=100000) -> w94
  w95 = cluster{"t0": f64, "dt": f64, "Y": f64[]} {all zero or empty}
  Property Node(instance in=w95, "dt"=w17, "Y"=w94) -> (instance out=w96)
  call "MT Format Eye Diagram (complex).gvi"(waveform=w96, symbol rate=$"symbol rate (sym/s)", eye length=2) -> (eye diagram=w97)
  $"Eye Diagram" <- w97
  $"Error Corrected Signal" <- w60
  Number To Decimal String(number=$"Noise Selection") -> (decimal integer string=w98)
  Concatenate Strings("matlab -batch \"rls ", w98, "; exit\"") -> w99
  # Running the RLS function in MATLAB by giving the selected reference noise as input
  call "System Exec.gvi"(command line=w99, working directory=w61, run minimized?=TRUE)
